# Grasshopper definition log_azure_application_insights.gh (Grasshopper 1.0.7)

instkey = Text()
tagstr = Text()
D = Data()
instkey_2 = Text(instkey)
tagstr_2 = Text(tagstr)
D_2 = Data(D)
log_appinsights = CSharpScript(Outputs=D_2, TagStr=tagstr_2, InstrumentationKey=instkey_2)  # -> out, Debug; inputs Outputs: tree, TagStr: String, InstrumentationKey: String
# ---------- log_appinsights: C# usings ----------
using System.Threading.Tasks;
using GH_IO;
using GH_IO.Serialization;
using System.Linq;
# ---------- log_appinsights: C# ----------
    if (string.IsNullOrEmpty(InstrumentationKey)) return;

    try
    {
      var doc = Grasshopper.Instances.ActiveCanvas.Document;
      if (doc == null) return;

      Dictionary<string, string> properties = new Dictionary<string, string>();

      if (!string.IsNullOrEmpty(TagStr))
      {
        var tagPairs = TagStr.Split(';');
        foreach (var pair in tagPairs)
        {
          var firstColonIndex = pair.IndexOf(':');
          if (firstColonIndex >= 0)
          {
            var key = pair.Substring(0, firstColonIndex);
            var val = pair.Substring(firstColonIndex + 1);
            properties[key] = val;
          }
        }
      }

      Task.Run(() => SendLogMessage(InstrumentationKey, properties)).Wait();
      Debug = "Log message sent successfully.";
    }
    catch (Exception ex)
    {
      Debug = "Failed to send log message: " + ex.Message
        + ((ex.InnerException == null) ? "" : " Inner: " + ex.InnerException.Message);
    }
# ---------- log_appinsights: C# additional code ----------
  private string json;

  // Function to send log message to Azure Application Insights
  public void SendLogMessage(string instrumentationKey, Dictionary<string, string> properties)
  {
    var url = "https://dc.services.visualstudio.com/v2/track";

    var propertyEntries = properties.Select(kvp => "\"" + kvp.Key + "\":\"" + kvp.Value + "\"");
    var propertiesJson = String.Join(",", propertyEntries);

    var logMessage = "{"
      + "\"name\":\"Microsoft.ApplicationInsights.Event\","
      + "\"time\":\"" + DateTime.UtcNow.ToString("O") + "\","
      + "\"iKey\":\"" + instrumentationKey + "\","
      + "\"data\":{"
      + "\"baseType\":\"EventData\","
      + "\"baseData\":{"
      + "\"ver\":2,"
      + "\"name\":\"Custom Log\","
      + "\"properties\":{" + propertiesJson + "}"
      + "}"
      + "}"
      + "}";

    json = logMessage;

    var data = System.Text.Encoding.UTF8.GetBytes(logMessage);

    var request = System.Net.WebRequest.Create(url);
    request.Method = "POST";
    request.ContentType = "application/json";
    request.Headers.Add("X-Api-Key", instrumentationKey);
    request.ContentLength = data.Length;

    using (var stream = request.GetRequestStream())
    {
      stream.Write(data, 0, data.Length);
    }

    using (var response = request.GetResponse() as System.Net.HttpWebResponse)
    {
      if (response.StatusCode != System.Net.HttpStatusCode.OK)
      {
        throw new Exception("Failed to send log message. Status code: " + response.StatusCode);
      }
    }
  }
# ---------- end log_appinsights ----------
debug = Debug(log_appinsights.Debug)
panel = Panel(log_appinsights.out)
