# Grasshopper definition simplify.gh (Grasshopper 1.0.7)

D = Data()
D_2 = Data(D)
tstat = TreeStatistics(Tree=D_2)  # -> Paths, Length, Count
larger = LargerThan(FirstNumber=tstat.Count, SecondNumber="1")  # -> LargerThan, OrEqualTo
flatten = FlattenTree(Tree=D_2, Path="{0}")
simplify = SimplifyTree(Tree=D_2, Front=False)
filter = StreamFilter(Gate=larger.LargerThan, Stream0=flatten, Stream1=simplify)
D_3 = Data(filter)
D_4 = Data(D_3)
